# Grasshopper definition JSL_Interaction.gh (Grasshopper 1.0.7)
# plug-ins: Firefly.X, HAL for Grasshopper, gHowl, Machina

sessionsettings = SessionSettings()
# First thing that we do is that we move the robot to start point and make sure that the robot is there
osc_sender = OSCSender(IPAddressOfUDPServer="127.0.0.1", UDPPort=8001)
osc_c = OSCChannel()
crv = Curve(<curve referenced from the Rhino model>)

connect_to_bridge = BooleanToggle(False)
reset_button_hit_onece_at_the_beginning = Button()  # "Reset_Button (hit onece at the beginning to start)"
starting_point = Point(<point referenced from the Rhino model>)
layer_offeset = Slider(5.27, range=-10..10)
timer = Timer(TimerInterval=20, Target=python)  # disabled
initial_speed = Panel("50")

# ---- group: mm/sec
speed = Slider(47, range=5..120)

# ----
offset_x = Slider(0, range=-10..10)
offset_y = Slider(0, range=-10..10)
offset_z = Slider(0, range=-10..10)

number_slider = Slider(30, range=0..100)

# ---- group: check in relation to offset
flip = FlipCurve(Curve=crv)  # -> Curve, Flag

# ----
series = Series(Start=0, Step=Slider(5, range=0..10), Count=Slider(10, range=0..10))
Z = UnitZ(Factor=series)
crv_2 = Curve(<curve referenced from the Rhino model>)
move = Move(Geometry=flip.Curve, Motion=Z)  # -> Geometry, Transform
divide = DivideCurve(Curve=crv_2, Count=number_slider, Kinks=False)  # -> Points, Tangents, Parameters
offset = OffsetCurve(Curve=move.Geometry, Distance=layer_offeset, Plane=PlaneXY(0, 0, 0), Corners=1)  # -> simplify(flatten(Curve))
divlength = DivideLength(Curve=move.Geometry, Length=Slider(5.46, range=0..10))  # -> simplify(Points), Tangents, Parameters
offset_2 = OffsetCurve(Curve=crv_2, Distance=Slider(10, range=0..10), Plane=PlaneXY(0, 0, 0), Corners=1)
divide_2 = DivideCurve(Curve=offset_2, Count=number_slider, Kinks=False)  # -> Points, Tangents, Parameters
flatten = FlattenTree(Tree=divlength.Points, Path="{0}")
lng = ListLength(List=divlength.Points)  # -> flatten(Length)
crv_cp = CurveClosestPoint(Point=divide.Points, Curve=offset_2)  # -> Point, Parameter, Distance
python = GhPythonScript(
    points=flatten,
    speed=speed,
    reset=reset_button_hit_onece_at_the_beginning,
    start_point=starting_point,
    offset_crv=offset,
    offset_x=offset_x,
    offset_y=offset_y,
    offset_z=offset_z,
    points_each_layer=lng)  # -> out, a, b, send, send_point, next_point, curve; inputs points: list of Point3d, speed: Int32, start_point: Point3d, offset_crv: list of Curve, points_each_layer: list of Int32
# ---------- python: Python ----------
__author__ = "mogha"
__version__ = "2021.05.05"

import rhinoscriptsyntax as rs
import Rhino.Geometry as rg
import time
import math



if "context" not in globals() or reset:
    context = points    
    start_time = time.time()
    send_point = start_point
    send = True
    i = 0
    layer = 0
    context.pop(0)
    next_point = context[0]
    dist = send_point.DistanceTo(next_point)
    required_time = dist/speed
    #now = time.time()
    end_time = start_time + required_time


if i == points_each_layer[layer]:
    i = 0
    layer = layer+1

number = layer* points_each_layer[layer] + i
curve = offset_crv [layer]
translation = (offset_x, offset_y, offset_z)
translation_matrix = rs.XformTranslation((offset_x, offset_y, offset_z))
curve = rs.TransformObject(curve,translation_matrix)


if len(context)> 0:
    b = time.time() - end_time
    if time.time()>= end_time:
        send = True
        i = i+1

        send_point_param = rs.CurveClosestPoint(curve,context[0])
        send_point = rs.EvaluateCurve(curve,send_point_param)
        #send_point = rs.PointTransform(send_point, translation_matrix)

        context.pop(0)
        next_point_param = rs.CurveClosestPoint(curve,context[0])
        next_point = rs.EvaluateCurve(curve,next_point_param)
        #next_point = rs.PointTransform(next_point, translation_matrix)
        
        dist = send_point.DistanceTo(next_point)
        required_time = dist/speed
        now = time.time()
        end_time = now + required_time
    else:
        send = False


a = context
c = reset
# ---------- end python ----------
preview = CustomPreview(Geometry=move.Geometry, Material=ColourSwatch(SwatchColor=RGB(135, 135, 135)))
panel = Panel(python.b)
panel_2 = Panel(python.send)
panel_3 = Panel(python.send_point)
panel_4 = Panel(python.next_point)
crv_3 = Curve(python.curve)
curvepoint = PointOnCurve(crv_3, parameter=0)
crv_cp_2 = CurveClosestPoint(Point=curvepoint, Curve=offset)  # -> Point, Parameter, Distance
equals = Equality(FirstNumber=crv_cp_2.Distance, SecondNumber="0")  # -> Equality, Inequality
cull = CullPattern(List=offset, CullPattern=equals.Inequality)
preview_2 = CustomPreview(Geometry=cull, Material=ColourSwatch(SwatchColor=RGB(0, 0, 0)))
panel_5 = Panel(python.a)
pt = Point(python.send_point)
pt_2 = Point(python.next_point)
pt_3 = Point(pt)
sned_to_bridge = Boolean(python.send)
pln = Plane(pt_3)
preview_3 = CustomPreview(Geometry=pt_2, Material=ColourSwatch(SwatchColor=RGB(255, 155, 33)))
preview_4 = CustomPreview(Geometry=pt, Material=ColourSwatch(SwatchColor=RGB(255, 209, 153)))
preview_5 = CustomPreview(Geometry=crv_3, Material=ColourSwatch(SwatchColor=RGB(250, 250, 250)))

deconstruct_plane = DeconstructPlane(Plane=pln)  # -> Origin, XAxis, YAxis, ZAxis
rotate_3d = Rotate3D(Geometry=pln, Angle="PI", Center=deconstruct_plane.Origin, Axis=deconstruct_plane.XAxis)  # -> Geometry, Transform

# ----
# First run the command AxesTo(0,0,0,0,90,0)
speedto = SpeedTo(Speed=speed, Relative=False)
transformto = TransformTo(Plane=rotate_3d.Geometry, Relative=False)
merge = Merge(Data1=speedto, Data2=transformto)

# ---- group: Concatenate all Actions into a Program
data = Data(merge)

# ----
panel_6 = Panel(data)

# ---- group: Generate native code
createrobot = CreateRobot(Name="toolPather", Brand="ABB")
compileprogram = CompileProgram(Robot=createrobot, Actions=data, InLineTargets=Toggle(True), Comments=Toggle(True))

# ---- group: Stream the program directly to the robot via the Machina Bridge
# Check these tutorials on how to set up real-time control with your machine: https://www.youtube.com/playlist?list=PLvxxYImPCApXj3tHVKmpTS_AuMPngnA47
connect = Connect(URL="ws://127.0.0.1:6999/Bridge", Name="Grasshopper", Connect=connect_to_bridge)  # -> Status, Bridge
panel_7 = Panel(connect.Status)
listen = Listen(Bridge=connect.Bridge, Autoupdate=True, Interval=66)
send = Send(Bridge=connect.Bridge, Actions=data, Send=sned_to_bridge)  # -> Sent, Instructions
panel_8 = Panel(send.Instructions)
panel_9 = Panel(send.Sent)
actionexecuted = ActionExecuted(BridgeMessage=listen)  # -> LastAction, ActionTCP, ActionAxes, ActionExternalAxes, PendingActions, PendingActionsOnDevice
panel_10 = Panel(actionexecuted.LastAction)
panel_11 = Panel(actionexecuted.PendingActions)

# ---- group: Stream code to file: right-click on panel and stream contents to a text file in your system
panel_12 = Panel(compileprogram)

# ----
motionupdate = MotionUpdate(BridgeMessage=listen)  # -> TCP, Axes, ExternalAxes

# ---- group: Starting Action
pln_2 = Plane(starting_point)
speedto_2 = SpeedTo(Speed=initial_speed, Relative=False)
axesto = AxesTo(A1="0", A2="0", A3="0", A4="0", A5="90", A6="0", Relative=False)

deconstruct_plane_2 = DeconstructPlane(Plane=pln_2)  # -> Origin, XAxis, YAxis, ZAxis
rotate_3d_2 = Rotate3D(Geometry=pln_2, Angle="PI", Center=deconstruct_plane_2.Origin, Axis=deconstruct_plane_2.XAxis)  # -> Geometry, Transform

transformto_2 = TransformTo(Plane=rotate_3d_2.Geometry, Relative=False)
merge_2 = Merge(Data1=speedto_2, Data2=axesto, Data3=transformto_2)

# ----
send_2 = Send(Bridge=connect.Bridge, Actions=merge_2, Send=Button())  # -> Sent, Instructions
